# Dynamo custom node ActiveView.SetPhase.dyf (Dynamo 1.3.2.2480)
# category: Zhukoven.Revit.Views
# Input phase that you would like to set to the active view.

Phase = Input()
python_script = Python(IN[0]=Phase)
# ---------- python_script.python (29 lines) ----------
#Author Konstantin Zhukoven @ https://zhukoven.com
#Tested to work with Dynamo 1.3.0+
import clr
clr.AddReference('RevitAPI')
from Autodesk.Revit.DB import *

clr.AddReference("RevitNodes")
import Revit
clr.ImportExtensions(Revit.Elements)

clr.AddReference("RevitServices")
import RevitServices
from RevitServices.Persistence import DocumentManager
from RevitServices.Transactions import TransactionManager

doc = DocumentManager.Instance.CurrentDBDocument
aview = doc.ActiveView
phase = UnwrapElement(IN[0])
result = []

TransactionManager.Instance.EnsureInTransaction(doc)
try:
	aview.get_Parameter(BuiltInParameter.VIEW_PHASE).Set(phase.Id)
	result.append(True)
except:
	result.append(False)
TransactionManager.Instance.TransactionTaskDone()

OUT = (aview,result)
# ----------------------------------------
code_block = CodeBlock(seq=python_script) { seq[0]; seq[1]; }
View = Output(code_block.out0)
Result = Output(code_block.out1)  # Boolean
