# Dynamo custom node AllElementsOfCategoryAtLevel.dyf (Dynamo 1.3.4.6666)
# category: Zhukoven.Revit.Elements
# Select all elements of the specified category at the specified level.

Level = Input()
all_elements_at_level = ElementsAtLevel(Level)
getCategory = Element.GetCategory(all_elements_at_level)
id = Category.Id(getCategory)
Category = Input(Category : Category)
id_2 = Category.Id(Category)
code_block = CodeBlock(a=id, b=id_2) { a==b; }
filterByBoolMask = List.FilterByBoolMask(list=all_elements_at_level, mask=code_block)
Elements = Output(filterByBoolMask.in)
