# Dynamo custom node BoundingBox.ToSectionBox.dyf (Dynamo 1.3.0.875)
# category: Zhukoven.Revit.BoundingBoxes
# Convert Dynamo BoundingBox to Revit Section Box, and apply it to the desired 3D view.

BoundingBox = Input()
View = Input()
python_script = Python(IN[0]=BoundingBox, IN[1]=View)
# ---------- python_script.python (33 lines) ----------
#Based on the code originally posted by Dimitar Venkov
#Tested to work with Dynamo 1.3.0+
import clr
clr.AddReference("RevitAPI")
import Autodesk
from Autodesk.Revit.DB import *

clr.AddReference("RevitNodes")
import Revit
clr.ImportExtensions(Revit.GeometryConversion)
clr.ImportExtensions(Revit.Elements)

clr.AddReference("RevitServices")
import RevitServices
from RevitServices.Persistence import DocumentManager
from RevitServices.Transactions import TransactionManager

doc = DocumentManager.Instance.CurrentDBDocument
bbox = IN[0]
view = UnwrapElement(IN[1])
try:
    TransactionManager.Instance.EnsureInTransaction(doc)
    newmax = UnwrapElement(bbox.MaxPoint).ToRevitType()
    newmin = UnwrapElement(bbox.MinPoint).ToRevitType()
    newbox = BoundingBoxXYZ()
    newbox.Max = newmax
    newbox.Min = newmin

    z = view.SetSectionBox(newbox)

    OUT = "Done"
except:
    OUT = "Error"
# ----------------------------------------
Result = Output(python_script)
