# Dynamo custom node Element.CopyID.dyf (Dynamo 1.3.0.875)
# category: Zhukoven.Revit.Elements
# This node copies element's ID to clipboard.

Element = Input(Element : Element)  # Input single element to copy its ID to clipboard
id = Element.Id(Element)
string_from_object = FromObject(id)
python_script = Python(IN[0]=string_from_object)
# ---------- python_script.python (18 lines) ----------
#Refer to https://github.com/andydandy74/ClockworkForDynamo
import clr
import System
from System.Threading import Thread, ThreadStart
clr.AddReference("System.Windows.Forms")

def SetText(text):
    def thread_proc():
        System.Windows.Forms.Clipboard.SetText(text)
    t = Thread(ThreadStart(thread_proc))
    t.ApartmentState = System.Threading.ApartmentState.STA
    t.Start()
    
try:
	SetText(IN[0])
	OUT = IN[0]
except:
	OUT = 'Error: element ID could not be copied to clipboard'
# ----------------------------------------
id_2 = Output(python_script)  # "id"
