# Dynamo custom node FamilyInstance.IsMirrored.dyf (Dynamo 1.3.3.4111)
# category: Zhukoven.Revit.Families
# Check if the input families are mirrored in the model. Output type is boolean (true/false). Switch Lasing to Longest if you input a list of family instances.

familyInstance = Input()  # Input family instance(s)
code_block = CodeBlock(item=familyInstance) { Flatten({item}); }
python_script = Python(IN[0]=code_block)
# ---------- python_script.python (20 lines) ----------
#Tested to work with Dynamo 1.3.0 + 
#Author © Konstantin Zhukoven @ https:\\zhukoven.com
import clr
clr.AddReference('RevitAPI')
from Autodesk.Revit.DB import *

clr.AddReference("RevitNodes")
import Revit
clr.ImportExtensions(Revit.Elements)

clr.AddReference("RevitServices")
import RevitServices
from RevitServices.Persistence import DocumentManager
doc = DocumentManager.Instance.CurrentDBDocument

family = UnwrapElement(IN[0])
for i in family:
	isMirrored = i.Mirrored
#Output
OUT = isMirrored
# ----------------------------------------
mirrored = Output(python_script)  # Boolean
