# Dynamo custom node FamilyType.Activate.dyf (Dynamo 1.3.0.875)
# category: Zhukoven.Revit.Elements
# This node eliminates the error "The symbol is not active" when placing family instances.

empty = List.Empty()
FamilyType = Input()
create = List.Create(empty, FamilyType)
flatten = Flatten(create)
python_script = Python(IN[0]=flatten)
# ---------- python_script.python (27 lines) ----------
#Author Konstantin Zhukoven @ https://zhukoven.com
#Tested to work with Dynamo 1.3.0+
import clr
clr.AddReference('RevitAPI')
from Autodesk.Revit.DB import *

clr.AddReference("RevitNodes")
import Revit
clr.ImportExtensions(Revit.Elements)
clr.ImportExtensions(Revit.GeometryConversion)

clr.AddReference("RevitServices")
import RevitServices
from RevitServices.Persistence import DocumentManager
from RevitServices.Transactions import TransactionManager

doc = DocumentManager.Instance.CurrentDBDocument
famtype = UnwrapElement(IN[0])

TransactionManager.Instance.EnsureInTransaction(doc)
# Activating the Family Symbol
for i in famtype:
	if i.IsActive == False:
		i.Activate()
		doc.Regenerate()
TransactionManager.Instance.TransactionTaskDone()
OUT = famtype
# ----------------------------------------
FamilyType_2 = Output(python_script)  # "FamilyType"
