# Dynamo custom node MultilineText.Strings.dyf (Dynamo 1.3.0.875)
# category: Zhukoven.Revit.Text
# Extract each line from multiline text parameter as a list of strings.

MultilineText = Input()  # Input multiline text parameter value (single string with multiple lines)
python_script = Python(IN[0]=MultilineText)
# ---------- python_script.python (12 lines) ----------
#Tested in Revit 2016+ and Dynamo 1.3.0 
#Author © Konstantin Zhukoven @ https:\\zhukoven.com
import clr
clr.AddReference('ProtoGeometry')
from Autodesk.DesignScript.Geometry import *
#Введенные в этом узле данные сохраняется в виде списка в переменных IN.
dataEnteringNode = IN
mline = IN[0]
nlines = mline.splitlines()
count = len(nlines)
#Назначьте вывод переменной OUT.
OUT = nlines
# ----------------------------------------
Strings = Output(python_script)
