# Dynamo custom node RebarShape.GetByName.dyf (Dynamo 1.3.3.4111)
# category: Zhukoven.Revit.Rebar
# Select rebar shape element by its name (String).

element_types = ElementTypes("RebarShape")
all_elements_of_type = ElementsOfType(element_types)
name = Element.Name(all_elements_of_type)
string = Input()
code_block = CodeBlock(name=name, str=string) { name==str; }
filterByBoolMask = List.FilterByBoolMask(list=all_elements_of_type, mask=code_block)
element = Output(filterByBoolMask.in)
