# Dynamo custom node Room.Unplace.dyf (Dynamo 1.3.2.2480)
# category: Zhukoven.Revit.Rooms
# Input room(s) that you wish to unplace (remove from the model views). These rooms would be stored in the project, and could be placed again in another location.

Room = Input()
code_block = CodeBlock(item=Room) { Flatten({item}); }
python_script = Python(IN[0]=code_block)
# ---------- python_script.python (30 lines) ----------
#Author Konstantin Zhukoven @ https://zhukoven.com
#Tested to work with Dynamo 1.3.0+
import clr
clr.AddReference("RevitNodes")
import Revit

# Import DocumentManager and TransactionManager
clr.AddReference("RevitServices")
import RevitServices
from RevitServices.Persistence import DocumentManager
from RevitServices.Transactions import TransactionManager
# Import RevitAPI
clr.AddReference("RevitAPI")
import Autodesk
from Autodesk.Revit.DB import *

doc = DocumentManager.Instance.CurrentDBDocument
rooms = UnwrapElement(IN[0])

TransactionManager.Instance.EnsureInTransaction(doc)

if isinstance(rooms, list):
	unplaceRooms = rooms.Unplace()
else:
	unplaceRooms = []
	for i in rooms:
		unplaceRooms.append(i.Unplace())
TransactionManager.Instance.TransactionTaskDone()

OUT = rooms
# ----------------------------------------
Room_2 = Output(python_script)  # "Room"
