# Dynamo custom node ScopeBox.CenterPoint.dyf (Dynamo 1.3.0.875)
# category: Zhukoven.Revit.ScopeBoxes
# This node takes Scope Box element and extracts its center point as location.

ScopeBox = Input(ScopeBox : Element)  # Input Scope Box element(s)
boundingBox = Element.BoundingBox(ScopeBox)
# note: Node from "Zhukoven.com" package
centerPoint = Custom[BoundingBox.CenterPoint](boundingBox=boundingBox)  # Input Bounding Box element to get its center point. This node is little and lightweight, as it doesn't convert bounding box to geometry to get its centroid point.
Point = Output(centerPoint)
