# Dynamo custom node Sheet.Viewports.dyf (Dynamo 1.3.4.6666)
# category: Zhukoven.Revit.Views
# Query viewports from the input sheet(s).

sheet_s = Input()  # "sheet(s)"
code_block = CodeBlock(item=sheet_s) { Flatten({item}); }
python_script = Python(IN[0]=code_block)
# ---------- python_script.python (26 lines) ----------
#Author Konstantin Zhukoven @ https://zhukoven.com
#Tested to work with Dynamo 1.3.3+
import clr
clr.AddReference("RevitAPI")
import Autodesk
from Autodesk.Revit.DB import *

clr.AddReference("RevitNodes")
import Revit
clr.ImportExtensions(Revit.GeometryConversion)
clr.ImportExtensions(Revit.Elements)

clr.AddReference("RevitServices")
import RevitServices
from RevitServices.Persistence import DocumentManager
doc = DocumentManager.Instance.CurrentDBDocument

sheets = UnwrapElement(IN[0])

viewports = []
for v in sheets:
	viewportIds = v.GetAllViewports()
	for i in viewportIds:
		elt = doc.GetElement(i)
		viewports.append(elt)
OUT = viewports
# ----------------------------------------
viewports = Output(python_script)
