# Dynamo custom node Stairs.GetLandings.dyf (Dynamo 1.3.2.2480)
# category: Zhukoven.Revit.Stairs
# This node returns all the stairs landing components in the stairs.

Stair = Input()  # Input stair(s) element(s)
code_block = CodeBlock(item=Stair) { Flatten({item}); }
python_script = Python(IN[0]=code_block)
# ---------- python_script.python (22 lines) ----------
#Tested to work with Dynamo 1.3.0 + 
#Author © Konstantin Zhukoven @ https:\\zhukoven.com
import clr
clr.AddReference('RevitAPI')
from Autodesk.Revit.DB import *

clr.AddReference("RevitNodes")
import Revit
clr.ImportExtensions(Revit.Elements)

clr.AddReference("RevitServices")
import RevitServices
from RevitServices.Persistence import DocumentManager
doc = DocumentManager.Instance.CurrentDBDocument

stair = UnwrapElement(IN[0])
for i in stair:
	landings = i.GetStairsLandings()
	for i in landings:
		elt = doc.GetElement(i)
#Output
OUT = elt
# ----------------------------------------
StairsLandings = Output(python_script)
