# Dynamo custom node String.AddPrefixSuffix.dyf (Dynamo 1.3.2.2480)
# category: Zhukoven.Revit.Text
# Add prefix and suffix to the input string.

String = Input()  # Input string
Prefix = Input()  # String
Suffix = Input()  # String
code_block = CodeBlock(t3=String, t4=Prefix, t6=Suffix) { t2 = DSCore.String.Insert(t3, 0, t4); t5 = DSCore.String.Length(t2); t7 = DSCore.String.Insert(t2, t5, t6); }
String_2 = Output(code_block.t7)  # "String"; Output string with prefix & suffix
