# Dynamo custom node Tag.GetHost.dyf (Dynamo 1.3.0.875)
# category: Zhukoven.Revit.Tags
# Input tags to get their host elements.

Tag = Input()
python_script = Python(IN[0]=Tag)
# ---------- python_script.python (18 lines) ----------
#Author Konstantin Zhukoven @ https://zhukoven.com
#Tested to work with Dynamo 1.3.0+
import clr
clr.AddReference("RevitAPI")
import Autodesk
from Autodesk.Revit.DB import *

clr.AddReference("RevitServices")
import RevitServices
from RevitServices.Persistence import DocumentManager
doc = DocumentManager.Instance.CurrentDBDocument

tag = UnwrapElement(IN[0])
thost, lthost = [], []
for i in tag:
	thost.append(doc.GetElement(i.TaggedLocalElementId))
	lthost.append(i.TaggedElementId.LinkedElementId)
OUT = thost, lthost
# ----------------------------------------
code_block = CodeBlock(seq=python_script) { seq[0]; seq[1]; }
Element = Output(code_block.out0)
LinkedElementId = Output(code_block.out1)  # Returns invalid values if the host element is local
