# Dynamo custom node View.SetFilterVisibility.dyf (Dynamo 1.3.3.4651)
# category: Zhukoven.Revit.Views
# This node sets view filter visibility (graphics overrides) for the chosen view(s) and filter(s). Input view(s), ParameterFilterElement and boolean switch, which toggles filter visibility.

View_s = Input()  # "View(s)"
code_block = CodeBlock(item=View_s) { Flatten({item}); }
ParameterFilterElement = Input()
Visible = Input(Visible : bool=True)
python_script = Python(IN[0]=code_block, IN[1]=ParameterFilterElement, IN[2]=Visible)
# ---------- python_script.python (33 lines) ----------
#Author Konstantin Zhukoven @ https://zhukoven.com
#Tested to work with Dynamo 1.3.0+
import clr
clr.AddReference('RevitAPI')
from Autodesk.Revit.DB import *

clr.AddReference("RevitNodes")
import Revit
clr.ImportExtensions(Revit.Elements)

clr.AddReference("RevitServices")
import RevitServices
from RevitServices.Persistence import DocumentManager
from RevitServices.Transactions import TransactionManager

doc = DocumentManager.Instance.CurrentDBDocument
view = UnwrapElement(IN[0])
filter = UnwrapElement(IN[1])
boolean = IN[2]
result = []
viewlist = []

TransactionManager.Instance.EnsureInTransaction(doc)

try:
	for i in view:
		viewlist.append(i.SetFilterVisibility(filter.Id, boolean))
		result.append(True)
except:
	result.append(False)
TransactionManager.Instance.TransactionTaskDone()

OUT = (view,result)
# ----------------------------------------
Result = Output(python_script)  # Boolean
